# Grasshopper definition isoview compare  version 0.2.gh (Grasshopper 1.0.7)
# plug-ins: Caribou, Groundhog, DeCodingSpaces, Human UI, Hare

top_most_view = TopMostView()
# upload your OSM data here
file_path = FilePath("D:\DESIGN\Master works\Fork it\06.site\Berlin\Berlin.osm\Berlin-latest-S")
# Boundary-Berlin Wall
# 
# Find other types of city boundaries or walls in barrier-city wall
curve = Curve(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)

# ---- group: Find the center point of the park and divide the boundary line segments equally
specify_features = SpecifyFeatures(selectionIncludesObscure=True, selectionSerialised="leisure=park")
file_path_2 = FilePath(file_path)
text = Text(specify_features)
extract_ways = ExtractWays(OSMFilePath=file_path_2, OSMFeatures=text)  # -> Ways, Tags, Report
curve_2 = Curve(graft(extract_ways.Ways))
area = Area(Geometry=curve_2)  # -> Area, Centroid
divide_distance = DivideDistance(Curve=curve_2, Distance=Slider(100, range=0..1000))  # -> Points, Tangents, Parameters
point = Point(area.Centroid)

# ----
panel = Panel("transportation base map")
specify_features_2 = SpecifyFeatures(
    selectionIncludesObscure=True,
    selectionSerialised="highway=bridleway,highway=cycleway,highway=motorway,highway=pedestrian,highway=primary,highway=proposed,highway=raceway,highway=residential,highway=secondary,highway=services,highway=tertiary,highway=unclassified,route=yes,route=bus,route=ferry,route=foot,route=road")
file_path_3 = FilePath(file_path)
# Click Activate to get the base map of the project, and the user can bake
# it to rhino to store it, because the data will be relatively large
extract_ways_2 = ExtractWays(OSMFilePath=file_path_3, OSMFeatures=specify_features_2)  # -> Ways, Tags, Report
curve_3 = Curve(flatten(extract_ways_2.Ways))
custom_preview = CustomPreview(Geometry=curve_3, Material=graft(ColourSwatch(SwatchColor=RGB(204, 204, 204))))

panel_2 = Panel("buiding data")
specify_features_3 = SpecifyFeatures(selectionIncludesObscure=True, selectionSerialised="building=*")
text_2 = Text(specify_features_3)
file_path_4 = FilePath(file_path)
extract_ways_3 = ExtractWays(OSMFilePath=file_path_4, OSMFeatures=text_2)  # -> Ways, Tags, Report
curve_4 = Curve(graft(extract_ways_3.Ways))
boundary_surfaces = BoundarySurfaces(Edges=curve_4)
custom_preview_2 = CustomPreview(Geometry=boundary_surfaces, Material=ColourSwatch(SwatchColor=RGBA(235, 230, 230, 250)))

# ---- group: Visualize berlin wall
offset_curve = OffsetCurve(Curve=curve, Distance=Slider(20, range=0..100), Corners=1)
loft = Loft(
    Curves=flatten([offset_curve, curve]),
    Options={Adjust=False, Closed=False, LoftEnds=0, LoftSimp=0, LoftType=0, Rebuild=10, Refit=0.01})
custom_preview_3 = CustomPreview(Geometry=loft, Material=ColourSwatch(SwatchColor=RGBA(18, 14, 14, 250)))

# ----
panel_3 = Panel("main road")
specify_features_4 = SpecifyFeatures(selectionIncludesObscure=True, selectionSerialised="highway=primary,highway=secondary")
file_path_5 = FilePath(file_path)
text_3 = Text(specify_features_4)
extract_ways_4 = ExtractWays(OSMFilePath=file_path_5, OSMFeatures=text_3)  # -> Ways, Tags, Report
curve_5 = Curve(flatten(extract_ways_4.Ways))
custom_preview_4 = CustomPreview(Geometry=curve_5, Material=ColourSwatch(SwatchColor=RGBA(22, 219, 219, 250)))

generate_new_data = Button()

# ---- group: Draw the boundary bubbles of the park to better visualize the city green space
base_charge = Slider(2, range=0..15)
charge_multiplier = Slider(550, range=0..1000)
point_2 = Point(divide_distance.Points)
integer = Integer(base_charge)
list_length = ListLength(List=point_2)
multiplication = Multiplication(A=integer, B=charge_multiplier)
repeat_data = RepeatData(Data=multiplication, Length=list_length)
metaball_t_custom = MetaBallTCustom(Points=point_2, Charge=repeat_data, Plane=PlaneXY(0, 0, 0), Threshold=0.5, Accuracy=Slider(5, range=0..5))
curve_6 = Curve(metaball_t_custom)
# Subtract the surface of the inner ring and outer ring
number_slider = Slider(1, range=0..1)
list_item = ListItem(List=curve_6, Index=number_slider, Wrap=True)
boundary_surfaces_2 = BoundarySurfaces(Edges=list_item)
custom_preview_5 = CustomPreview(Geometry=boundary_surfaces_2, Material=graft(ColourSwatch(SwatchColor=RGBA(125, 171, 79, 69))))

# ---- group: Point Network (with minimum/maximum distance)
connections = Slider(7, range=0..25)
number = Number(connections)
number_2 = Number(Slider(200, range=0..1000))
number_3 = Number(Slider(800, range=0..100000))
point_3 = Point(flatten(point))
proximity_2d = Proximity2D(Points=point_3, Plane=PlaneXY(0, 0, 0), Group=number, MinRadius=number_2, MaxRadius=number_3)  # -> Links, Topology
geometry = Geometry(proximity_2d.Links)
geometry_2 = Geometry(geometry)
custom_preview_6 = CustomPreview(Geometry=geometry_2, Material=ColourSwatch(SwatchColor=RGB(212, 214, 152)))  # disabled

# ----
curve_7 = Curve(curve_3)
number_slider_2 = Slider(0.9, range=0..1)
number_slider_3 = Slider(17, range=0..100)
chart_type = ValueList({"Horizontal Cluster Bar Chart": 0, "Vertical Cluster Bar Chart": 1, "Horizontal Stacked Bar Chart": 2, "Vertical Stacked Bar Chart": 3, "Pie Chart": 4}, selected="Horizontal Cluster Bar Chart")
chart_type_2 = ValueList({"Horizontal Cluster Bar Chart": 0, "Vertical Cluster Bar Chart": 1, "Horizontal Stacked Bar Chart": 2, "Vertical Stacked Bar Chart": 3, "Pie Chart": 4}, selected="Vertical Cluster Bar Chart")
panel_4 = Panel("""Reaching distance 
of green space""")
number_slider_4 = Slider(6, range=0..10)
random_color = RandomColor(Number=number_slider_3, Seed=number_slider_4)

# ---- group: Generate an analysis range around different points of the Berlin Wall to test the difference between East and West Berlin road iso-view
panel_5 = Panel("car range")
panel_6 = Panel("pedestrian range")
panel_7 = Panel("Bike range")
point_4 = Point(point)
closest_point = ClosestPoint(Point=point_4, Cloud=flatten(divide_distance.Points))  # -> flatten(ClosestPoint), CPIndex, Distance
number_slider_5 = Slider(1, range=0..1)
number_slider_6 = Slider(2, range=0..10)
number_slider_7 = Slider(5, range=0..10)
number_slider_8 = Slider(4, range=0..10)
number_slider_9 = Slider(3, range=0..10)
number_slider_10 = Slider(6, range=0..10)
number_slider_11 = Slider(8, range=0..10)
number_slider_12 = Slider(7, range=0..10)
divide_distance_2 = DivideDistance(Curve=curve, Distance=Slider(1200, range=0..10000))  # -> Points, Tangents, Parameters
point_5 = Point(divide_distance_2.Points)
# West Berlin boundary
curve_8 = Curve(<curve referenced from the Rhino model>)

# ---- group: 1km,2km,5km analysis scope
# Shpere of equilateral points
# of the Berlin wall
number_slider_13 = Slider(2000, range=0..10000)
number_slider_14 = Slider(5000, range=0..10000)
circle = Circle(Plane=point_5, Radius=Slider(1000, range=0..10000))

# ---- group: Generate an analysis range around different points of the Berlin Wall to test the difference between East and West Berlin road iso-view (continued)
list_item_2 = ListItem(List=flatten(circle), Index=number_slider_6, Wrap=True)
list_item_3 = ListItem(List=flatten(circle), Index=number_slider_5, Wrap=True)
list_item_4 = ListItem(List=flatten(circle), Index=number_slider_7, Wrap=True)
list_item_5 = ListItem(List=flatten(circle), Index=number_slider_8, Wrap=True)
list_item_6 = ListItem(List=flatten(circle), Index=number_slider_9, Wrap=True)
list_item_7 = ListItem(List=flatten(circle), Index=number_slider_10, Wrap=True)
list_item_8 = ListItem(List=flatten(circle), Index=number_slider_11, Wrap=True)
list_item_9 = ListItem(List=flatten(circle), Index=number_slider_12, Wrap=True)
point_in_curve = PointInCurve(Point=closest_point.ClosestPoint, Curve=list_item_2)  # -> Relationship, Point
point_in_curve_2 = PointInCurve(Point=closest_point.ClosestPoint, Curve=list_item_5)  # -> Relationship, Point
point_in_curve_3 = PointInCurve(Point=closest_point.ClosestPoint, Curve=list_item_3)  # -> Relationship, Point
point_in_curve_4 = PointInCurve(Point=closest_point.ClosestPoint, Curve=list_item_4)  # -> Relationship, Point
point_in_curve_5 = PointInCurve(Point=closest_point.ClosestPoint, Curve=list_item_6)  # -> Relationship, Point
point_in_curve_6 = PointInCurve(Point=closest_point.ClosestPoint, Curve=list_item_7)  # -> Relationship, Point
point_in_curve_7 = PointInCurve(Point=closest_point.ClosestPoint, Curve=list_item_8)  # -> Relationship, Point; disabled
point_in_curve_8 = PointInCurve(Point=closest_point.ClosestPoint, Curve=list_item_9)  # -> Relationship, Point; disabled
dispatch = Dispatch(List=closest_point.ClosestPoint, DispatchPattern=point_in_curve.Relationship)  # -> ListA, ListB
dispatch_2 = Dispatch(List=closest_point.ClosestPoint, DispatchPattern=point_in_curve_3.Relationship)  # -> ListA, ListB
dispatch_3 = Dispatch(List=closest_point.ClosestPoint, DispatchPattern=point_in_curve_4.Relationship)  # -> ListA, ListB
dispatch_4 = Dispatch(List=closest_point.ClosestPoint, DispatchPattern=point_in_curve_5.Relationship)  # -> ListA, ListB
dispatch_5 = Dispatch(List=closest_point.ClosestPoint, DispatchPattern=point_in_curve_2.Relationship)  # -> ListA, ListB
dispatch_6 = Dispatch(List=closest_point.ClosestPoint, DispatchPattern=point_in_curve_6.Relationship)  # -> ListA, ListB
dispatch_7 = Dispatch(List=closest_point.ClosestPoint, DispatchPattern=point_in_curve_7.Relationship)  # -> ListA, ListB; disabled
dispatch_8 = Dispatch(List=closest_point.ClosestPoint, DispatchPattern=point_in_curve_8.Relationship)  # -> ListA, ListB; disabled
point_6 = Point(dispatch_2.ListA)
point_7 = Point(graft(dispatch_3.ListA))
point_8 = Point(graft(dispatch_4.ListA))
point_9 = Point(dispatch.ListA)
point_10 = Point(dispatch_5.ListA)
point_11 = Point(graft(dispatch_6.ListA))
point_12 = Point(graft(dispatch_7.ListA))  # disabled
point_13 = Point(graft(dispatch_8.ListA))  # disabled

point_in_curve_9 = PointInCurve(Point=point_8, Curve=curve_8)  # -> Relationship, Point
list_item_10 = ListItem(List=point_5, Index=number_slider_9, Wrap=True)
dispatch_9 = Dispatch(List=point_8, DispatchPattern=point_in_curve_9.Relationship)  # -> ListA, ListB
point_14 = Point(graft(dispatch_9.ListA))
point_15 = Point(graft(dispatch_9.ListB))
point_16 = Point(list_item_10)

point_in_curve_10 = PointInCurve(Point=point_9, Curve=curve_8)  # -> Relationship, Point
list_item_11 = ListItem(List=point_5, Index=number_slider_6, Wrap=True)
dispatch_10 = Dispatch(List=point_9, DispatchPattern=point_in_curve_10.Relationship)  # -> ListA, ListB
point_17 = Point(graft(dispatch_10.ListA))
point_18 = Point(graft(dispatch_10.ListB))
point_19 = Point(list_item_11)

point_in_curve_11 = PointInCurve(Point=point_7, Curve=curve_8)  # -> Relationship, Point
list_item_12 = ListItem(List=point_5, Index=number_slider_7, Wrap=True)
dispatch_11 = Dispatch(List=point_7, DispatchPattern=point_in_curve_11.Relationship)  # -> ListA, ListB
point_20 = Point(graft(dispatch_11.ListB))
point_21 = Point(graft(dispatch_11.ListA))
point_22 = Point(list_item_12)

point_in_curve_12 = PointInCurve(Point=point_10, Curve=curve_8)  # -> Relationship, Point
list_item_13 = ListItem(List=point_5, Index=number_slider_8, Wrap=True)
dispatch_12 = Dispatch(List=point_10, DispatchPattern=point_in_curve_12.Relationship)  # -> ListA, ListB
point_23 = Point(graft(dispatch_12.ListA))
point_24 = Point(graft(dispatch_12.ListB))
point_25 = Point(list_item_13)

point_in_curve_13 = PointInCurve(Point=point_6, Curve=curve_8)  # -> Relationship, Point
list_item_14 = ListItem(List=point_5, Index=number_slider_5, Wrap=True)
dispatch_13 = Dispatch(List=point_6, DispatchPattern=point_in_curve_13.Relationship)  # -> ListA, ListB
point_26 = Point(graft(dispatch_13.ListB))
point_27 = Point(graft(dispatch_13.ListA))
point_28 = Point(list_item_14)

point_in_curve_14 = PointInCurve(Point=point_13, Curve=curve_8)  # -> Relationship, Point; disabled
list_item_15 = ListItem(List=point_5, Index=number_slider_12, Wrap=True)  # disabled
dispatch_14 = Dispatch(List=point_13, DispatchPattern=point_in_curve_14.Relationship)  # -> ListA, ListB; disabled
point_29 = Point(graft(dispatch_14.ListA))  # disabled
point_30 = Point(graft(dispatch_14.ListB))  # disabled
point_31 = Point(list_item_15)  # disabled

point_in_curve_15 = PointInCurve(Point=point_11, Curve=curve_8)  # -> Relationship, Point; disabled
list_item_16 = ListItem(List=point_5, Index=number_slider_10, Wrap=True)  # disabled
dispatch_15 = Dispatch(List=point_11, DispatchPattern=point_in_curve_15.Relationship)  # -> ListA, ListB; disabled
point_32 = Point(graft(dispatch_15.ListA))  # disabled
point_33 = Point(graft(dispatch_15.ListB))  # disabled
point_34 = Point(list_item_16)  # disabled

point_in_curve_16 = PointInCurve(Point=point_12, Curve=curve_8)  # -> Relationship, Point; disabled
list_item_17 = ListItem(List=point_5, Index=number_slider_11, Wrap=True)  # disabled
dispatch_16 = Dispatch(List=point_12, DispatchPattern=point_in_curve_16.Relationship)  # -> ListA, ListB; disabled
point_35 = Point(graft(dispatch_16.ListB))
point_36 = Point(graft(dispatch_16.ListA))  # disabled
point_37 = Point(list_item_17)  # disabled

# ---- group: Project the points on the berlin wall to the city roads
divide_distance_3 = DivideDistance(Curve=curve_3, Distance=Slider(100, range=0..100))  # -> Points, Tangents, Parameters
closest_point_2 = ClosestPoint(Point=point_23, Cloud=flatten(divide_distance_3.Points))  # -> ClosestPoint, CPIndex, Distance
closest_point_3 = ClosestPoint(Point=point_25, Cloud=flatten(divide_distance_3.Points))  # -> ClosestPoint, CPIndex, Distance
point_38 = Point(flatten(closest_point_2.ClosestPoint))
point_39 = Point(closest_point_3.ClosestPoint)

# ---- group: Calculate the shortest distance
intersect_all = IntersectAll(crv=curve_7)
shortest_path = ShortestPath(Curves=intersect_all, Starts=point_39, Ends=point_38)  # -> ShortestPath, Succession, Direction, Length
curve_9 = Curve(shortest_path.ShortestPath)

# ----
# input parameters processing
obstacles_polylines_crv = Curve(curve_4)
walking_path = Curve(reparameterize(graft(curve_9)))
explode = Explode(Curve=obstacles_polylines_crv, Recursive=True)  # -> Segments, Vertices
evaluate_curve = EvaluateCurve(Curve=walking_path, Parameter=number_slider_2)  # -> Point, Tangent, Angle
obstacles_line = Line(simplify(explode.Segments))

# ----
# change this parameter
# to move the isovist along the path
isovist = Isovist(
    VantagePointS=evaluate_curve.Point,
    ObstacleLines=flatten(obstacles_line),
    ViewingDirection=evaluate_curve.Tangent,
    ViewingRange=Slider(100, range=1..200),
    ViewingAngle=Slider(160, range=0..360),
    Precision=Slider(360, range=1..720),
    ShowPolygon=Toggle(True),
    ShowRadials=Toggle(True),
    UseGPU=Toggle(True))  # -> IsovistPolygon, Radials, ObstacleVisibility, IsovistProperties

partition_list = PartitionList(List=isovist.IsovistProperties, Size=Slider(17, range=0..100))

# ----
# isovist output
value_list = ValueList({"Area": 0, "Area (Dist Weighted)": 1, "Perimeter": 2, "Compactness": 3, "Circularity": 4, "ConvexDeficiency": 5, "Occlusivity": 6, "Min Radial": 7, "Max Radial": 8, "Mean Radial": 9, "Standard Deviation": 10, "Variance": 11, "Skewness": 12, "Dispersion": 13, "Elongation": 14, "Drift Magnitude": 15, "Drift Angle": 16}, selected="Occlusivity")
isovist_srf = Surface(isovist.IsovistPolygon)
list_item_18 = ListItem(List=partition_list, Index=value_list, Wrap=True)
custom_preview_7 = CustomPreview(Geometry=isovist_srf, Shader=ColourSwatch(SwatchColor=RGBA(255, 123, 0, 165)))
data_recorder = DataRecorder(list_item_18, DataLimit=-10, RecordData=True)
quick_graph = QuickGraph(data_recorder, SortOrder=0)

circle_2 = Circle(Plane=point_25, Radius=Slider(50, range=0..100))
circle_3 = Circle(Plane=point_23, Radius=Slider(20, range=0..100))
circle_4 = Circle(Plane=point_24, Radius=Slider(15, range=0..100))
boundary_surfaces_3 = BoundarySurfaces(Edges=circle_2)
boundary_surfaces_4 = BoundarySurfaces(Edges=circle_3)
boundary_surfaces_5 = BoundarySurfaces(Edges=circle_4)
custom_preview_8 = CustomPreview(Geometry=boundary_surfaces_3, Material=ColourSwatch(SwatchColor=RGB(232, 93, 227)))
custom_preview_9 = CustomPreview(Geometry=boundary_surfaces_5, Material=ColourSwatch(SwatchColor=RGB(0, 151, 171)))
custom_preview_10 = CustomPreview(Geometry=boundary_surfaces_4, Material=ColourSwatch(SwatchColor=RGB(93, 23, 232)))

length = Length(Curve=curve_9)
curve_10 = Curve(flatten(curve_9))
end_points = EndPoints(Curve=curve_9)  # -> Start, End
cluster = Cluster(curve=curve_10)
subtraction = Subtraction(A=number_slider_2, B=Slider(0.2, range=0..1))
offset_curve_2 = OffsetCurve(Curve=curve_9, Distance=Slider(9, range=0..100), Corners=1)
curve_11 = Curve(graft(curve_9))
integer_2 = Integer(length)
gradient = Gradient(
    LowerLimit=0,
    UpperLimit=1,
    Parameter=cluster,
    stops=[0: RGB(243, 57, 0), 0.1: RGB(236, 27, 60), 0.2: RGB(210, 0, 118), 0.3: RGB(103, 0, 120), 0.4: RGB(39, 72, 161), 0.5: RGB(1, 192, 229), 0.6: RGB(18, 178, 90), 0.7: RGB(79, 186, 8), 0.8: RGB(220, 237, 32), 0.9: RGB(247, 159, 20), 1: RGB(243, 57, 0)])
loft_2 = Loft(
    Curves=[offset_curve_2, curve_11],
    Options={Adjust=False, Closed=False, LoftEnds=0, LoftSimp=0, LoftType=0, Rebuild=10, Refit=0.01})
colour_swatch = ColourSwatch(SwatchColor=RGB(0, 0, 0))
evaluate_curve_2 = EvaluateCurve(Curve=walking_path, Parameter=subtraction)  # -> Point, Tangent, Angle
data = Data(reverse(graft(gradient)))
custom_preview_11 = CustomPreview(Geometry=loft_2, Material=data)
text_tag_3d = TextTag3D(
    Location=evaluate_curve_2.Point,
    Text=graft(integer_2),
    Size=Slider(16, range=0..100),
    Colour=colour_swatch,
    Justification=7)
text_tag_3d_2 = TextTag3D(Location=point_25, Text="Start ", Size=Slider(41, range=0..100), Colour=colour_swatch, Justification=7)
text_tag_3d_3 = TextTag3D(Location=evaluate_curve.Point, Text="End", Size=Slider(24, range=0..100), Colour=colour_swatch, Justification=7)

chart_type_3 = ValueList({"Horizontal Cluster Bar Chart": 0, "Vertical Cluster Bar Chart": 1, "Horizontal Stacked Bar Chart": 2, "Vertical Stacked Bar Chart": 3, "Pie Chart": 4}, selected="Vertical Stacked Bar Chart")
data_2 = Integer(partition_list)
seq = Sequence(Count=number_slider_3, CharPool="ABCDEFGHIJKLMNOPQRSTUVWXYZ", Format="W-road {0}")

create_multi_chart = CreateMultiChart(
    Data=data_2,
    Names=seq,
    Title="West Berlin IsoView",
    SubTitle="Comprehensive comparison",
    ClusterTitle=seq,
    ChartType=chart_type_3)
generate_new_data_2 = Button()
data_recorder_2 = DataRecorder(generate_new_data_2, DataLimit=-10, RecordData=True)
mass_addition = MassAddition(Input=data_recorder_2)  # -> Result, PartialResults
new_data_set = NewDataSet(S=mass_addition.Result, data=data_2)
set_multi_chart_contents = SetMultiChartContents(ChartToModify=create_multi_chart, NewChartValues=new_data_set)

chart_appearance = ChartAppearance(ChartToModify=create_multi_chart, Colors=random_color, Legend=Toggle(True), Title=Toggle(True))

curve_12 = Curve(graft(curve_9))
length_2 = Length(Curve=curve_12)
data_3 = Data(flatten(length_2))

list_length_2 = ListLength(List=flatten(length_2))

mass_addition_2 = MassAddition(Input=flatten(length_2))  # -> Result, PartialResults
division = Division(A=mass_addition_2.Result, B=list_length_2)

seq_2 = Sequence(Count=list_length_2, CharPool="ABCDEFGHIJKLMNOPQRSTUVWXYZ", Format="West {0}")
random_color_2 = RandomColor(Number=list_length_2, Seed=Slider(8, range=0..10))
integer_3 = Integer(division)

text_4 = Text(flatten("West Berlin"))
data_4 = Data(flatten(integer_3))
create_chart = CreateChart(
    Data=data_4,
    Names=text_4,
    Title="West＆East Berlin ",
    SubTitle="Green SpaceReaching distance(Average)",
    ChartType=chart_type_2)
chart_appearance_2 = ChartAppearance(
    ChartToModify=create_chart,
    Colors=[ColourSwatch(SwatchColor=RGB(57, 196, 196)), ColourSwatch(SwatchColor=RGB(196, 12, 12))],
    Legend=Toggle(True),
    Title=Toggle(True))

integer_4 = Integer(data_3)

text_5 = Text(flatten(seq_2))
create_chart_2 = CreateChart(Data=integer_4, Names=text_5, Title="West Berlin ", SubTitle=panel_4, ChartType=chart_type)
chart_appearance_3 = ChartAppearance(ChartToModify=create_chart_2, Colors=random_color_2, Legend=Toggle(True), Title=Toggle(True))

value_list_2 = ValueList({"Area": 0, "Area (Dist Weighted)": 1, "Perimeter": 2, "Compactness": 3, "Circularity": 4, "ConvexDeficiency": 5, "Occlusivity": 6, "Min Radial": 7, "Max Radial": 8, "Mean Radial": 9, "Standard Deviation": 10, "Variance": 11, "Skewness": 12, "Dispersion": 13, "Elongation": 14, "Drift Magnitude": 15, "Drift Angle": 16}, selected="Area")
number_slider_15 = Slider(17, range=0..100)
list_item_19 = ListItem(List=data_2, Index=value_list_2, Wrap=True)
chart_type_4 = ValueList({"Horizontal Cluster Bar Chart": 0, "Vertical Cluster Bar Chart": 1, "Horizontal Stacked Bar Chart": 2, "Vertical Stacked Bar Chart": 3, "Pie Chart": 4}, selected="Vertical Cluster Bar Chart")
seq_3 = Sequence(Count=number_slider_15, CharPool="ABCDEFGHIJKLMNOPQRSTUVWXYZ", Format="W-road {0}")
text_6 = Text(flatten(seq_3))
data_5 = Data(flatten(list_item_19))
create_chart_3 = CreateChart(Data=data_5, Names=text_6, Title="West Berlin IsoView", SubTitle="Occlusivity", ChartType=chart_type_4)

random_color_3 = RandomColor(Number=number_slider_15, Seed=number_slider_4)

chart_appearance_4 = ChartAppearance(ChartToModify=create_chart_3, Colors=random_color_3, Legend=Toggle(True), Title=Toggle(True))

# ---- group: Create Window from UI Elements
create_stack = CreateStack(UIElements=[create_chart_2, create_chart, create_multi_chart, create_chart_3], Horizontal=False)
launch_window = LaunchWindow(
    Show=Toggle(True),
    Name="Berlin Visible green space & reachable rate",
    Width=Slider(600, range=0..1000),
    Height=Slider(1000, range=0..1000),
    ChildStatus=0,
    EnableHorizScroll=False)
add_elements = AddElements(Window=launch_window, Elements=flatten(create_stack), DoVLChecking=True)  # -> AddedElements, ElementNames

# ==== cluster IntersectAll
crv = ClusterInput()
# Thanks to user Systemiq on the (old) Grasshopper forums http://www.grasshopper3d.com/forum/topics/split-curve-s-by-intersection-with-other-curve-s
crv_2 = Curve(reparameterize(flatten(crv)))
lng = ListLength(List=crv_2)
mcx = MultipleCurves(Curves=crv_2)  # -> Points, IndexA, IndexB, ParamA, ParamB
series = Series(Start=0, Step=1, Count=lng)
int = Integer(series)
mindex = MemberIndex(Set=[mcx.IndexA, mcx.IndexB], Member=int)  # -> Index, Count
pshift = ShiftPaths(Data=mindex.Index, Offset=-1)
number_slider = Slider(0.0001, range=1e-05..0.1)
item = ListItem(List=[mcx.ParamA, mcx.ParamB], Index=pshift, Wrap=True)
unflatten = UnflattenTree(Tree=item, Guide=mindex.Index)
cset = CreateSet(List=unflatten)  # -> Set, Map
larger = LargerThan(FirstNumber=cset.Set, SecondNumber=expr("1-x", number_slider))  # -> LargerThan, OrEqualTo
smaller = SmallerThan(FirstNumber=cset.Set, SecondNumber=number_slider)  # -> SmallerThan, OrEqualTo
or = GateOr(A=smaller.SmallerThan, B=larger.LargerThan)
cull = CullPattern(List=cset.Set, CullPattern=invert(or))
vb = VBScript(x=cull)  # -> out, A
# ---------- vb: VB ----------
    If x Is Nothing Then
      a = nothing
    Else
      a = x
    End If
# ---------- end vb ----------
shatter = Shatter(Curve=graft(crv_2), Parameters=vb.A)  # -> simplify(Segments)
curve = Curve(flatten(shatter))
curve_2 = ClusterOutput(curve)

# ==== cluster Cluster
curve = ClusterInput()
length = Length(Curve=curve)
sort_list = SortList(Keys=length)  # -> Keys, ValuesValuesA
list_item = ListItem(List=sort_list.Keys, Index=0, Wrap=True)
list_item_2 = ListItem(List=sort_list.Keys, Index=-1, Wrap=True)
construct_domain = ConstructDomain(DomainStart=list_item, DomainEnd=list_item_2)
remap_numbers = RemapNumbers(Value=length, Source=construct_domain, Target=Domain(0, 1))  # -> Mapped, Clipped
mapped = ClusterOutput(remap_numbers.Mapped)

# ==== cluster NewDataSet
data = ClusterInput()
data_2 = Data(data)
lng = ListLength(List=flatten(data_2))
S = ClusterInput()
random = Random(Range="1000", Number=lng, Seed=S)
int = Integer(random)
unflatten = UnflattenTree(Tree=int, Guide=data_2)
T = ClusterOutput(unflatten)
